# Grasshopper definition local_code_gis_tools.ghx (Grasshopper 0.8.11)

panel = Panel("""multipatch.shp
polylineZ.shp
line.shp
rectangle.shp""")
concat = Concatenate(Start="_Project", End=".shp")
concat_2 = Concatenate(Start=panel, End=concat)
rep = ReplaceString(String=panel, Find=".shp", Replace=concat)
weave = Weave(Pattern=[0, 1], Stream0=rep, Stream1="lotsWGS84UTMZ10.shp", NullGaps=False)
item = ListItem(List=weave, Index=Slider(1, range=0..10), Wrap=False)
concat_3 = Concatenate(Start="/Users/demonchaux/Dropbox/localcode/rhinotools/testdata/", End=item)
panel_2 = Panel(rep)
panel_3 = Panel(item)
panel_4 = Panel(concat_3)
readshapefile = PythonScript(shapefile=panel_4, read=Toggle(False), moveToCenter=Toggle(True), GhMemory=0)  # -> out, features, geometry; inputs shapefile: String, read: Boolean, moveToCenter: Boolean
# ---------- readshapefile: Python ----------
#import Rhino
import os
import sys

# edit sys.path
package = '~/Dropbox/localcode/rhinotools'
expanded = os.path.abspath(os.path.expanduser(package))
if expanded not in sys.path:
    sys.path.append(expanded)

decom = [
    'Shp',
    'ShpFeature',
    'ShpToRhino',
    ]
for m in decom:
    if m in sys.modules:
        del sys.modules[m]

# get the module
import Shp
import ShpFeature
import ShpToRhino


if read:
    if shapefile:
        if not os.path.exists(shapefile):
            print 'The shapefile you gave me does not exist.\nDouble check the path: "%s"' % shapefile
        # import stuff
        out = ShpToRhino.ShpFileToRhino( shapefile, moveToCenter )
        geometry = out
    else:
        print 'no shapefile supplied'
# ---------- end readshapefile ----------
panel_5 = Panel(readshapefile.out)
panel_6 = Panel(readshapefile.features)
geo = Geometry(readshapefile.geometry)
item_2 = ListItem(List=geo, Index=Slider(0, range=0..200000), Wrap=False)
panel_7 = Panel(readshapefile.geometry)
