# Grasshopper definition read props.gh (Grasshopper 0.9.61)
# plug-ins: Python Interpreter

crv = Curve([<curve referenced from the Rhino model> x44])
python = PythonScript(shpGeom=crv)  # -> out, keys, values, D; inputs shpGeom: GeometryBase
# ---------- python: Python ----------
class UserDictionary():
    def __init__(self, keys, values):
        self.d = dict(zip(keys, values))
    def __repr__(self):
        return "UserDictionary"

if shpGeom:
    keys = shpGeom.UserDictionary.Keys
    values = shpGeom.UserDictionary.Values
    D = UserDictionary(keys, values)
# ---------- end python ----------
panel = Panel(python.D)
